vi "index.gviweb"   [G Web Development Software 22.3.0]
panel controls:
  "Usuario": string
  "Contraseña": string
  "Confirm Button": bool
  "Logo3G_Image": string = "Image/LOGO%202024%20V3%20205X50.png"
  "Logo3G_Image_2": string = "Image/LOGO%202024%20V3%20205X50.png"
  "SmartPhone": bool
  "Tab_3": i32
panel indicators:
  "Tab": i32
  "ELECTRIC ENERGY (kWh)": waveform<f64>
  "loop iteration": i32
  "Fecha | Hora": string
  "Server Active": bool
  "URL Image": string
  "CURRENT (A)": waveform<f32>
  "data cluster 1": T1
  "URL Image_2": string
  "data cluster 2": T2
  "ACTIVE POWER [kW]": waveform<f32>
  "APPARENT POWER (kVA)": waveform<f32>
  "TEMPERATURE [°C]": waveform<f64>
  "HUMIDITY [%]": waveform<f64>
  "data cluster 3": T3
  "TEMPERATURE [°C]_2": waveform<f64>
  "HUMIDITY [%]_2": waveform<f64>
  "CURRENT (A)_2": waveform<f32>
  "ELECTRIC ENERGY (kWh)_2": waveform<f64>
  "ACTIVE POWER [kW]_2": waveform<f32>
  "APPARENT POWER (kVA)_2": waveform<f32>
types:
  T1 = cluster{"phase voltage (V)": f32, "phase current (A)": f32, "phase frequency (Hz)": f32, "phase active power (kW)": f32, "phase apparent power (KVA)": f32, "phase power factor": f32}
  T2 = cluster{"active electric energy (kWh)": f64, "valor instantáneo (clp)": f64}
  T3 = cluster{"temperatura (°C)": f64, "humedad (%)": f64}
  T4 = cluster{"Date | Time": string, "data cluster 1": T1, "data cluster 2": T2, "app-active": bool, "data cluster 3": T3}
uses:
  NI::HTTP::Open HTTP Handle.gvi
  NI::HTTP::GET.gvi
  NI::HTTP::PUT Buffer.gvi
  NI::HTTP::Close HTTP Handle.gvi
diagram:
  disable {
    frame Enabled { }
    frame Disabled { }
  }
  sequence {
    frame 0 {
      Property Node(instance in=reference to "Usuario", "Value"="")
      Property Node(instance in=reference to "Contraseña", "Value"="")
      Property Node(instance in=reference to unnamed text, "Visible"=FALSE)
      $Tab <- 0
    }
  }
  call "Open HTTP Handle.gvi"(error in=no error) -> (client handle out=w1, error out=w2)
  s1 = w2  # shift register
  s2 = w1  # shift register
  while {
    Wait(time to wait=250)
    w3 = cluster{"user": string, "password": string} {all zero or empty}
    w4 = "https://energy-monitoring-demo-default-rtdb.firebaseio.com/access.json"
    call "GET.gvi"(client handle=s2, url=w4, error in=s1) -> (client handle out=w5, body=w6, error out=w7)
    Unflatten From Json(JSON string=w6, type and defaults=w3) -> (value=w8)
    case ($"Confirm Button") {
      frame False, Default {
        w9 = FALSE
        w10 = FALSE
      }
      frame True {
        Property Node(instance in=w8) -> ("user"=w11, "password"=w12)
        Is Equal(x=$Usuario, y=w11) -> w13
        Is Equal(x=w12, y=$Contraseña) -> w14
        Logical And(w13, w14) -> w9
        case (w9) {
          frame True {
            Property Node(instance in=reference to unnamed text, "Visible"=FALSE)
          }
          frame False {
            Property Node(instance in=reference to unnamed text, "Visible"=TRUE)
          }
        }
        w10 = $SmartPhone
      }
    }
    next s1 = w7
    next s2 = w5
    stop if w9
  }
  w15 = T4 {all zero or empty}  # data-send
  s3 = s2  # shift register
  s4 = s1  # shift register
  while (iteration -> i1) {
    Wait(time to wait=500)
    Get Current Time() -> (current time=w16)
    Format Date Time String(time format string (%c)="%Y-%m-%d | %H:%M:%S", time stamp=w16) -> (date/time string=w17)
    $"Fecha | Hora" <- w17
    disable {
      frame Enabled {
        w18 = s4
        w19 = s3
      }
      frame Disabled {
        w20 = "https://arc-flash-relay-default-rtdb.firebaseio.com/data-read.json"
        Property Node(instance in=cluster{"Reset": bool} {all zero or empty}) -> (instance out=w21)
        Flatten To Json(anything=w21) -> (JSON string=w22)
        call "PUT Buffer.gvi"(client handle=s3, url=w20, buffer=w22, error in=s4) -> (client handle out=w19, error out=w18)
        Wait(time to wait=100)
        Wait(time to wait=50)
      }
    }
    w23 = "https://energy-monitoring-demo-default-rtdb.firebaseio.com/data-send.json"
    Concatenate Strings(w23) -> w24
    call "GET.gvi"(client handle=w19, url=w24, error in=w18) -> (client handle out=w25, body=w26, error out=w27)
    Unflatten From Json(JSON string=w26, type and defaults=w15) -> (value=w28)
    Property Node(instance in=w28) -> ("app-active"=w29, "data cluster 1:phase current (A)"=w30, "data cluster 2:active electric energy (kWh)"=w31, "data cluster 1:phase active power (kW)"=w32, "data cluster 1:phase apparent power (KVA)"=w33, "data cluster 3:temperatura (°C)"=w34, "data cluster 3:humedad (%)"=w35, "data cluster 1"=w36, "data cluster 2"=w37, "data cluster 3"=w38)
    $"Server Active" <- w29
    case (w10) {
      frame False, Default {
        w39 = 1
      }
      frame True {
        w39 = 1
      }
    }
    $Tab <- w39
    Get Current Time() -> (current time=w40)
    Build Array(w31) -> w41
    Build Waveform Node(Y=w41, dt=1, t0=w40) -> (output waveform=w42)
    $"ELECTRIC ENERGY (kWh)" <- w42
    $"ELECTRIC ENERGY (kWh)_2" <- w42
    Build Array(w30) -> w43
    Build Waveform Node(Y=w43, dt=1, t0=w40) -> (output waveform=w44)
    $"CURRENT (A)" <- w44
    $"CURRENT (A)_2" <- w44
    Build Array(w32) -> w45
    Build Waveform Node(Y=w45, dt=1, t0=w40) -> (output waveform=w46)
    $"ACTIVE POWER [kW]" <- w46
    $"ACTIVE POWER [kW]_2" <- w46
    $"loop iteration" <- i1
    Build Array(w33) -> w47
    Build Waveform Node(Y=w47, dt=1, t0=w40) -> (output waveform=w48)
    $"APPARENT POWER (kVA)" <- w48
    $"APPARENT POWER (kVA)_2" <- w48
    Build Array(w34) -> w49
    Build Waveform Node(Y=w49, dt=1, t0=w40) -> (output waveform=w50)
    $"TEMPERATURE [°C]" <- w50
    $"TEMPERATURE [°C]_2" <- w50
    Build Array(w35) -> w51
    Build Waveform Node(Y=w51, dt=1, t0=w40) -> (output waveform=w52)
    $"HUMIDITY [%]" <- w52
    $"HUMIDITY [%]_2" <- w52
    $"data cluster 1" <- w36
    $"data cluster 2" <- w37
    $"data cluster 3" <- w38
    next s3 = w25
    next s4 = w27
    stop if FALSE
  }
  call "Close HTTP Handle.gvi"(client handle=s3, error in=s4)
